# Dynamo graph Aula_Fracta_Peano.dyn (Dynamo 2.13.1.3887)

valor_k = DoubleSlider(6, range=1..6 step 1)
valor_d = DoubleSlider(0.25, range=0.05..1 step 0.05)
modos = DoubleSlider(1, range=1..3 step 1)
rotação = DoubleSlider(0.125, range=0..1 step 0.125)
módulo_dimensional = DoubleSlider(125, range=50..300 step 25)
fractal_peano = Python(IN[0]=valor_k, IN[1]=valor_d, IN[2]=modos, IN[3]=rotação, IN[4]=módulo_dimensional)  # CPython3
# ---------- fractal_peano.python (58 lines) ----------
# Enable Python support and load DesignScript library
import clr
clr.AddReference('ProtoGeometry')
from Autodesk.DesignScript.Geometry import *

import math

def Dibuja( pto , d , m):

    ori  = CoordinateSystem.ByOrigin(pto)  
    pt1  = Point.ByCartesianCoordinates( ori ,  d ,  d ,  d )
    pt2  = Point.ByCartesianCoordinates( ori , -d ,  d ,  d ) 
    pt3  = Point.ByCartesianCoordinates( ori , -d , -d ,  d )
    pt4  = Point.ByCartesianCoordinates( ori ,  d , -d ,  d )
    
    if    (m == 1):
       Linhas.append(Line.ByStartPointEndPoint(pt1, pt2))
       Linhas.append(Line.ByStartPointEndPoint(pt2, pt3))
       Linhas.append(Line.ByStartPointEndPoint(pt3, pt4))
       Linhas.append(Line.ByStartPointEndPoint(pt4, pt1)) 
    elif  (m == 2): 
       Linhas.append(Line.ByStartPointEndPoint(pt1, pt2))
       Linhas.append(Line.ByStartPointEndPoint(pt2, pt3))
       Linhas.append(Line.ByStartPointEndPoint(pt4, pt1))            
    else:
       Linhas.append(Line.ByStartPointEndPoint(pt1, pt2))
       Linhas.append(Line.ByStartPointEndPoint(pt2, pt3))
       Linhas.append(Line.ByStartPointEndPoint(pt3, pt4))  
    return Linhas;

# IN[n] Parametros iniciais
kf     = IN[0]
fd     = IN[1]
mo     = IN[2]
di     = IN[3]
modulo = IN[4]
k      = int(kf)
tot    = pow(4, k) 

vx     = Vector.XAxis()
Linhas = []
pt0    = Point.ByCoordinates(0, 0, 0)
Dibuja ( pt0 , modulo , mo)
         
c = 0
while (len(Linhas) < tot) & (k > 1):
                    
      if c <= tot:
         lin  = Linhas[c]
         dim  = Line.DistanceAtParameter( lin , fd   )   
         pt0  = Line.PointAtParameter   ( lin , di )       
         Dibuja (pt0, dim, mo)
      else:
         break
      c   += 1         
         
# Retorno do outlet
OUT = Linhas
# ----------------------------------------
gerar_o_arquivo_txt_atualizado = CodeBlock(O=fractal_peano)
# ---------- gerar_o_arquivo_txt_atualizado.designscript (11 lines) ----------
O;
Pasta   = "C:\\WOM\\out-files\\";
ArqNo   = "CT_Fractal.txt";
Arquivo = Pasta + ArqNo;
Loc     = O.StartPoint;
x1      = Loc.X;
y1      = Loc.Y;
z1      = Loc.Z;

xyz     = x1 + "\n" + y1 + "\n" + z1;
DSOffice.Data.ExportCSV(Arquivo ,  xyz );
# ----------------------------------------
