# Dynamo graph Aula_Fracta_Pyt.dyn (Dynamo 2.13.1.3887)

tamanho = DoubleSlider(1.6, range=1..3 step 0.1)
angulo_de_abertura = DoubleSlider(10, range=10..170 step 45)
valor_k = DoubleSlider(33, range=0..40 step 1)
fator_altura = DoubleSlider(0, range=0..1 step 0.1)
fractal_y = Python(IN[0]=tamanho, IN[1]=angulo_de_abertura, IN[2]=valor_k, IN[3]=fator_altura)  # CPython3
# ---------- fractal_y.python (73 lines) ----------
# Enable Python support and load DesignScript library
import clr
clr.AddReference('ProtoGeometry')
#clr.AddReference('Musica')
from Autodesk.DesignScript.Geometry import *

# The inputs to this node will be stored as a list in the IN variables.
di = IN[0]
an = IN[1]
kf = IN[2]
al = IN[3]

k  = int(kf)
t  = pow(k, 2)
vx = Vector.XAxis()

Linhas = []

pt0  = Point.ByCoordinates(0 , 0,  0)
pt1  = Point.ByCoordinates(0 , di, 0)
lin  = Line.ByStartPointEndPoint(pt0, pt1)
ptm  = Line.PointAtParameter   (lin, 0.5)
dim  = Line.DistanceAtParameter(lin, 0.5)    
ori  = CoordinateSystem.ByOrigin(pt0)    
orm  = CoordinateSystem.ByOrigin(ptm)   
v0   = Point.AsVector(pt0)
vm   = Point.AsVector(ptm) 
va   = Vector.Subtract(vm, v0)    
ang  = Vector.AngleWithVector(vx, va)
         
lin.Dispose()

pt2  = Point.ByCylindricalCoordinates(orm,  ang + an, dim * al, dim)
pt3  = Point.ByCylindricalCoordinates(orm,  ang - an, dim * al, dim)    
lin0 = Line.ByStartPointEndPoint(pt0, ptm)
lin2 = Line.ByStartPointEndPoint(ptm, pt2)
lin3 = Line.ByStartPointEndPoint(ptm, pt3)
      
Linhas.append(lin0)
Linhas.append(lin2)
Linhas.append(lin3)

c = 0
while c < len(Linhas):

    l    = Linhas[c]
    pt0  = Line.PointAtParameter   (l, 0)
    pt1  = Line.PointAtParameter   (l, 1)
    ptm  = Line.PointAtParameter   (l, 0.5)
    dim  = Line.DistanceAtParameter(l, 0.5)
    l.Dispose()
    orm  = CoordinateSystem.ByOrigin(ptm)
    v0   = Point.AsVector(pt0)
    vm   = Point.AsVector(ptm) 
    va   = Vector.Subtract(vm, v0)    
    ang  = Vector.AngleWithVector(vx, va)
    
    pt2  = Point.ByCylindricalCoordinates(orm, ang + an, dim * al, dim)
    pt3  = Point.ByCylindricalCoordinates(orm, ang - an, dim * al, dim)  
    lin0 = Line.ByStartPointEndPoint(pt0, ptm)
    lin2 = Line.ByStartPointEndPoint(ptm, pt2)
    lin3 = Line.ByStartPointEndPoint(ptm, pt3) 
   
    Linhas.append(lin0)
    Linhas.append(lin2)
    Linhas.append(lin3)   
 
    if c == t:
       break
    c += 1

# Saida do outlet
OUT = Linhas
# ----------------------------------------
watch = Watch(fractal_y)
